# Dynamo graph areaChart.dyn (Dynamo 1.2.0.2654)

file_path = Filename(".\AreaChart.csv")
code_block = CodeBlock { 0; 650; }
domain = Charts.MiscNodes.Domain(code_block.out0, code_block.out1)
dataFromCSV = Charts.AreaChart.DataFromCSV(file_path, domain)
code_block_2 = CodeBlock { Color.ByARGB(1,100,100,100); 1400; 600; "Label"; 10; }
style = Charts.AreaChart.Style(code_block_2.out0, code_block_2.out1, code_block_2.out2, code_block_2.out3, code_block_2.out4)
chart = Charts.AreaChart.Chart(dataFromCSV, style)
create_row_container = MandrillRowContainerNode(chart)
create_report = MandrillReportNode(create_row_container)
report_window = MandrillWindowNodeModel()  # unwired: arg0
pdf_size = pdf_SizeUI("Letter11x17")
pdf_orientation = pdf_OrientationUI("Landscape")
pdf_fit_mode = pdf_FitModeUI("AutoFit")
code_block_3 = CodeBlock { 0; }
PDFStyle = Report.Pdf.PDFStyle(pdf_size, pdf_orientation, pdf_fit_mode, pdf_fit_mode, code_block_3)
file_path_2 = Filename("E:\Google Drive\Presentations_Workshops\2016 - AIA Presentation\JPG\areaChartExport.pdf")
saveAsPDF = Report.Pdf.SaveAsPDF(arg1=PDFStyle, arg2=file_path_2)  # unwired: arg0
code_block_4 = CodeBlock { {"A","B","C","D","E"}; {1,12,13,1,15}; }
code_block_5 = CodeBlock { 0; 16; }
domain_2 = Charts.MiscNodes.Domain(code_block_5.out0, code_block_5.out1)
data = Charts.AreaChart.Data(code_block_4.out0, code_block_4.out1, domain_2)
report_chrome_window = MandrillChromeWindowNodeModel()  # unwired: arg0
