# Dynamo graph barChart_01.dyn (Dynamo 1.1.0.2094)

file_path = Filename("E:\Google Drive\Work\Mandrill-dynamo\DynamoSamples\BarChart\barChartData.txt")
code_block = CodeBlock { 0.2; }
domain = Charts.MiscNodes.Domain(arg1=code_block)
dataFromCSV = Charts.BarChart.DataFromCSV(file_path, domain)
code_block_2 = CodeBlock { DSCore.Color.ByARGB(1,100,100,100); DSCore.Color.ByARGB(1,255,0,0); 1500; 600; "Test"; 24; }
style = Charts.BarChart.Style(code_block_2.out0, code_block_2.out1, code_block_2.out2, code_block_2.out3, code_block_2.out4, code_block_2.out5)
chart = Charts.BarChart.Chart(dataFromCSV, style)
watch = Watch(chart)
create_row_container = MandrillRowContainerNode(chart)
create_report = MandrillReportNode(create_row_container)
report_window = MandrillWindowNodeModel(create_report)
