# Dynamo graph gridsterBarChart1.dyn (Dynamo 1.2.0.2654)

code_block = CodeBlock { "Mandrill is a super dooper plug-in"; }
color_picker = nColorPicker()
code_block_2 = CodeBlock { 3; 2; }
address = Charts.MiscNodes.Address(code_block_2.out0, code_block_2.out1)
code_block_3 = CodeBlock { 400; 100; 24; }
font_weight = tn_FontWeight("bold")
font_style = tn_FontStyle("normal")
font_transform = tn_FontTransform("none")
style = Text.Text.Style(color_picker, address, code_block_3.out0, code_block_3.out1, code_block_3.out2, font_weight, font_style, font_transform)
create = Text.Text.Create(code_block, style)
file_path = Filename("..\..\_Logo\mandrillLogo-01.png")
code_block_4 = CodeBlock { 2; 2; }
address_2 = Charts.MiscNodes.Address(code_block_4.out0, code_block_4.out1)
code_block_5 = CodeBlock { 100; 100; }
code_block_6 = CodeBlock { "asd"; }
style_2 = Image.Image.Style(address_2, code_block_5.out0, code_block_5.out1, code_block_6)
create_2 = Image.Image.Create(file_path, style_2)
file_path_2 = Filename("E:\Google Drive\Work\Mandrill\_DynamoSamples\BarChart\Level1.csv")
dataFromCSV = Charts.DonutChart.DataFromCSV(file_path_2)
color_picker_2 = nColorPicker()
code_block_7 = CodeBlock { null; 400; 300; false; true; }
code_block_8 = CodeBlock { 11; 4; }
address_3 = Charts.MiscNodes.Address(code_block_8.out0, code_block_8.out1)
style_3 = Charts.DonutChart.Style(color_picker_2, code_block_7.out0, address_3, code_block_7.out1, code_block_7.out2, code_block_7.out3, code_block_7.out3)
chart = Charts.DonutChart.Chart(dataFromCSV, style_3)
file_path_3 = Filename("..\AreaChart\AreaChart.csv")
code_block_9 = CodeBlock { 0; 700; }
domain = Charts.MiscNodes.Domain(code_block_9.out0, code_block_9.out1)
dataFromCSV_2 = Charts.AreaChart.DataFromCSV(file_path_3, domain)
color_picker_3 = nColorPicker()
code_block_10 = CodeBlock { 1; 1; }
address_4 = Charts.MiscNodes.Address(code_block_10.out0, code_block_10.out1)
code_block_11 = CodeBlock { 600; 300; }
code_block_12 = CodeBlock { 4; }
style_4 = Charts.AreaChart.Style(color_picker_3, address_4, code_block_11.out0, code_block_11.out1, arg5=code_block_12)
chart_2 = Charts.AreaChart.Chart(dataFromCSV_2, style_4)
file_path_4 = Filename("..\..\_Logo\mandrillLogo1-01.png")
code_block_13 = CodeBlock { 1; 1; }
address_5 = Charts.MiscNodes.Address(code_block_13.out0, code_block_13.out1)
code_block_14 = CodeBlock { 400; 100; }
style_5 = Image.Image.Style(address_5, code_block_14.out0, code_block_14.out1)
create_3 = Image.Image.Create(file_path_4, style_5)
code_block_15 = CodeBlock { "No shit!"; }
code_block_16 = CodeBlock { 200; }
style_6 = Text.Text.Style(color_picker, address, code_block_16, code_block_3.out1, code_block_3.out2, font_weight, font_style, font_transform)
create_4 = Text.Text.Create(code_block_15, style_6)
code_block_17 = CodeBlock { 0; 26; }
domain_2 = Charts.MiscNodes.Domain(code_block_17.out0, code_block_17.out1)
dataFromCSV_3 = Charts.BarChart.DataFromCSV(file_path_2, domain_2)
color_picker_4 = nColorPicker()
color_picker_5 = nColorPicker()
code_block_18 = CodeBlock { 1; 1; }
address_6 = Charts.MiscNodes.Address(code_block_18.out0, code_block_18.out1)
code_block_19 = CodeBlock { 800; 400; 13; }
style_7 = Charts.BarChart.Style(color_picker_4, color_picker_5, address_6, code_block_19.out0, code_block_19.out1, arg6=code_block_19.out2)
chart_3 = Charts.BarChart.Chart(dataFromCSV_3, style_7)
create_report = MandrillReportNode(create, create_2, chart, chart_2, create_3, create_4, chart_3)
report_chrome_window = MandrillChromeWindowNodeModel(create_report)
pdf_size = pdf_SizeUI("A0")
pdf_orientation = pdf_OrientationUI("Landscape")
pdf_fit_mode = pdf_FitModeUI("AutoFit")
PDFStyle = Report.Pdf.PDFStyle(pdf_size, pdf_orientation, pdf_fit_mode, pdf_fit_mode)
file_path_5 = Filename(".\testPrint.pdf")
saveAsPDF = Report.Pdf.SaveAsPDF(arg1=PDFStyle, arg2=file_path_5)  # unwired: arg0
watch = Watch(saveAsPDF)
