# Dynamo graph AreaChart_fromCSV_sample1.dyn (Dynamo 1.0.0.1180)

code_block = CodeBlock { "Area Chart"; }
code_block_2 = CodeBlock { Color.ByARGB(1,0,0,0); }
number_slider = DoubleSlider(41, range=0..100 step 1)
font_weight = tn_FontWeight("bold")
font_style = tn_FontStyle("normal")
font_align = tn_FontAlign("center")
font_transform = tn_FontTransform("capitalize")
style = Text.Text.Style(code_block_2, number_slider, font_weight, font_style, font_align, font_transform)
create = Text.Text.Create(code_block, style)
row_container = MandrillRowContainerNode(create)
file_path = Filename("SampleDataCSV\AreaChart.csv")
code_block_3 = CodeBlock { 0; 650; }
domain = Common.Nodes.Domain(code_block_3.out0, code_block_3.out1)
dataFromCSV = Charts.AreaCharts.DataFromCSV(file_path, domain)
number_slider_2 = DoubleSlider(1847, range=1..2000 step 1)
number_slider_3 = DoubleSlider(593, range=1..1500 step 1)
code_block_4 = CodeBlock { "Area Chart Y-Axis"; Color.ByARGB(0,255,0); }
number_slider_4 = DoubleSlider(16, range=1..20 step 1)
style_2 = Charts.AreaCharts.Style(number_slider_2, number_slider_3, code_block_4.out0, code_block_4.out1, number_slider_4)
chart = Charts.AreaCharts.Chart(dataFromCSV, style_2)
row_container_2 = MandrillRowContainerNode(chart)
code_block_5 = CodeBlock { "X Axis: Some description."; "Y Axis: Some description."; }
number_slider_5 = DoubleSlider(24, range=0..100 step 1)
font_weight_2 = tn_FontWeight("normal")
font_style_2 = tn_FontStyle("italic")
font_align_2 = tn_FontAlign("left")
font_transform_2 = tn_FontTransform("none")
style_3 = Text.Text.Style(arg1=number_slider_5, arg2=font_weight_2, arg3=font_style_2, arg4=font_align_2, arg5=font_transform_2)
create_2 = Text.Text.Create(code_block_5.out0, style_3)
row_container_3 = MandrillRowContainerNode(create_2)
create_3 = Text.Text.Create(code_block_5.out1, style_3)
row_container_4 = MandrillRowContainerNode(create_3)
report = MandrillReportNode(row_container, row_container_2, row_container_3, row_container_4)
report_window = MandrillWindowNodeModel(report)
