# Dynamo graph AreaChart_sample1.dyn (Dynamo 0.9.2.4472)

code_block = CodeBlock { "Area Chart"; "Line Chart"; "Bar Chart"; }
code_block_2 = CodeBlock { 18; Color.ByARGB(255,150,150,150); }
font_weight = tn_FontWeights("bold")
font_style = tn_FontStyle("normal")
font_align = tn_FontAlign("center")
font_transform = tn_FontTransform("none")
textStyle = Mandrill.Nodes.Text.TextBox.TextStyle(code_block_2.out0, code_block_2.out1, font_weight, font_style, font_align, font_transform)
textNote = Mandrill.Nodes.Text.TextBox.TextNote(code_block.out0, textStyle)
create = List.Create(textNote)
row = Mandrill.Nodes.Containers.Container.Row(create)
integer_slider = IntegerSlider(119, range=1..150 step 1)
boolean = BoolSelector(true)
alphabeticalSequence = Custom[List.AlphabeticalSequence](n=integer_slider, upperCase=boolean)  # Creates a list of the first N letters of the alphabet (where 1 = A, 2 = B, ... , 27 = AA, 28 = AB etc.).
randomList = Math.RandomList(integer_slider)
code_block_3 = CodeBlock { 100; }
mul = randomList * code_block_3
code_block_4 = CodeBlock { 0; 100; }
domain = Mandrill.Nodes.D3js.AreaCharts.Domain(code_block_4.out0, code_block_4.out1)
data = Mandrill.Nodes.D3js.AreaCharts.Data(alphabeticalSequence, mul, domain)
code_block_5 = CodeBlock { 1500; 300; "Label"; Color.ByARGB(255,251,179,22); 25; }
style = Mandrill.Nodes.D3js.AreaCharts.Style(code_block_5.out0, code_block_5.out1, code_block_5.out2, code_block_5.out3, code_block_5.out4)
chart = Mandrill.Nodes.D3js.AreaCharts.Chart(data, style)
create_2 = List.Create(chart)
row_2 = Mandrill.Nodes.Containers.Container.Row(create_2)
textNote_2 = Mandrill.Nodes.Text.TextBox.TextNote(code_block.out1, textStyle)
create_3 = List.Create(textNote_2)
row_3 = Mandrill.Nodes.Containers.Container.Row(create_3)
domain_2 = Mandrill.Nodes.D3js.LineCharts.Domain(code_block_4.out0, code_block_4.out1)
data_2 = Mandrill.Nodes.D3js.LineCharts.Data(alphabeticalSequence, mul, domain_2)
style_2 = Mandrill.Nodes.D3js.LineCharts.Style(code_block_5.out0, code_block_5.out1, code_block_5.out2, code_block_5.out3, code_block_5.out4)
chart_2 = Mandrill.Nodes.D3js.LineCharts.Chart(data_2, style_2)
create_4 = List.Create(chart_2)
row_4 = Mandrill.Nodes.Containers.Container.Row(create_4)
textNote_3 = Mandrill.Nodes.Text.TextBox.TextNote(code_block.out2, textStyle)
create_5 = List.Create(textNote_3)
row_5 = Mandrill.Nodes.Containers.Container.Row(create_5)
domain_3 = Mandrill.Nodes.D3js.BarCharts.Domain(code_block_4.out0, code_block_4.out1)
data_3 = Mandrill.Nodes.D3js.BarCharts.Data(alphabeticalSequence, mul, domain_3)
code_block_6 = CodeBlock { Color.ByARGB(255,251,179,22); Color.ByARGB(255,150,150,150); }
style_3 = Mandrill.Nodes.D3js.BarCharts.Style(code_block_6.out0, code_block_6.out1, code_block_5.out0, code_block_5.out1, code_block_5.out2, code_block_5.out4)
chart_3 = Mandrill.Nodes.D3js.BarCharts.Chart(data_3, style_3)
create_6 = List.Create(chart_3)
row_6 = Mandrill.Nodes.Containers.Container.Row(create_6)
create_7 = List.Create(row, row_2, row_3, row_4, row_5, row_6)
createReport = Mandrill.Report.CreateReport(create_7)
