# Dynamo graph BarChart_sample1.dyn (Dynamo 0.9.1.4062)

integer_slider = IntegerSlider(26, range=1..26 step 1)
code_block = CodeBlock(x=integer_slider) { t1 = (0.12..0.12..#x); t2 = 0.01; }
random = Math.Random(code_block.t2)
map = List.Map(list=code_block.t1, f_x=random)
code_block_2 = CodeBlock { 5; }
round = Math.Round(number=map, digits=code_block_2)
maximumItem = List.MaximumItem(round)
integer_slider_2 = IntegerSlider(22, range=1..500 step 1)
code_block_3 = CodeBlock(x=integer_slider_2) { t1 = (0.12..0.12..#x); t2 = 0.01; }
random_2 = Math.Random(code_block_3.t2)
map_2 = List.Map(list=code_block_3.t1, f_x=random_2)
code_block_4 = CodeBlock { 5; }
round_2 = Math.Round(number=map_2, digits=code_block_4)
maximumItem_2 = List.MaximumItem(round_2)
code_block_5 = CodeBlock { 1; }
integer_slider_3 = IntegerSlider(15, range=1..26 step 1)
code_block_6 = CodeBlock(x=integer_slider_3) { t1 = (0.12..0.12..#x); t2 = 0.01; }
random_3 = Math.Random(code_block_6.t2)
map_3 = List.Map(list=code_block_6.t1, f_x=random_3)
code_block_7 = CodeBlock { 5; }
round_3 = Math.Round(number=map_3, digits=code_block_7)
maximumItem_3 = List.MaximumItem(round_3)
code_block_8 = CodeBlock { 1; }
code_block_9 = CodeBlock { "This is my Bar Chart!"; }
code_block_10 = CodeBlock { 36; Color.ByARGB(0,0,0); "bold"; "italic"; "center"; }
textStyle = Mandrill.Nodes.Text.TextBox.TextStyle(code_block_10.out0, code_block_10.out1, code_block_10.out2, code_block_10.out3, code_block_10.out4)
textNote = Mandrill.Nodes.Text.TextBox.TextNote(code_block_9, textStyle)
create = List.Create(textNote)
rowContainer = Mandrill.Nodes.Containers.Container.RowContainer(create)
code_block_11 = CodeBlock { "This bar chart demonstrates some fancy data visualization. Dynamo is so much cooler now, that we can do that."; }
code_block_12 = CodeBlock { 18; Color.ByARGB(0,75,75); "none"; "none"; "center"; }
textStyle_2 = Mandrill.Nodes.Text.TextBox.TextStyle(code_block_12.out0, code_block_12.out1, code_block_12.out2, code_block_12.out3, code_block_12.out4)
textNote_2 = Mandrill.Nodes.Text.TextBox.TextNote(code_block_11, textStyle_2)
create_2 = List.Create(textNote_2)
rowContainer_2 = Mandrill.Nodes.Containers.Container.RowContainer(create_2)
code_block_13 = CodeBlock { 26; true; }
alphabeticalSequence = Custom[List.AlphabeticalSequence](n=integer_slider_2, upperCase=code_block_13.out1)  # Creates a list of the first N letters of the alphabet (where 1 = A, 2 = B, ... , 27 = AA, 28 = AB etc.).
code_block_14 = CodeBlock { 0; 0.12; }
domain = Mandrill.Nodes.D3js.BarCharts.Domain(code_block_14.out0, code_block_14.out1)
data = Mandrill.Nodes.D3js.BarCharts.Data(alphabeticalSequence, round_2, domain)
code_block_15 = CodeBlock { 255; 0; }
byARGB = Color.ByARGB(r=code_block_15.out0, g=code_block_15.out1, b=code_block_15.out1)
byARGB_2 = Color.ByARGB(r=code_block_15.out1, g=code_block_15.out0, b=code_block_15.out1)
integer_slider_4 = IntegerSlider(1491, range=300..2000 step 1)
integer_slider_5 = IntegerSlider(333, range=300..1000 step 1)
code_block_16 = CodeBlock { "Frequency"; }
barStyle = Mandrill.Nodes.D3js.BarCharts.BarStyle(byARGB, byARGB_2, integer_slider_4, integer_slider_5, code_block_16)
barChart = Mandrill.Nodes.D3js.BarCharts.BarChart(data, barStyle)
create_3 = List.Create(barChart)
rowContainer_3 = Mandrill.Nodes.Containers.Container.RowContainer(create_3)
create_4 = List.Create(rowContainer, rowContainer_2, rowContainer_3)
createReport = Mandrill.Report.CreateReport(create_4)
domain_2 = Mandrill.Nodes.D3js.LineCharts.Domain(code_block_14.out0, code_block_14.out1)
lineChartData = Mandrill.Nodes.D3js.LineCharts.LineChartData(alphabeticalSequence, round_2, domain_2)
code_block_17 = CodeBlock { "label"; }
lineStyle = Mandrill.Nodes.D3js.LineCharts.LineStyle(integer_slider_4, integer_slider_5, code_block_17, byARGB)
lineChart = Mandrill.Nodes.D3js.LineCharts.LineChart(lineChartData, lineStyle)
create_5 = List.Create(lineChart)
rowContainer_4 = Mandrill.Nodes.Containers.Container.RowContainer(create_5)
textNote_3 = Mandrill.Nodes.Text.TextBox.TextNote(code_block_9, textStyle)
create_6 = List.Create(textNote_3)
rowContainer_5 = Mandrill.Nodes.Containers.Container.RowContainer(create_6)
textNote_4 = Mandrill.Nodes.Text.TextBox.TextNote(code_block_11, textStyle_2)
create_7 = List.Create(textNote_4)
rowContainer_6 = Mandrill.Nodes.Containers.Container.RowContainer(create_7)
code_block_18 = CodeBlock { 26; true; }
alphabeticalSequence_2 = Custom[List.AlphabeticalSequence](n=integer_slider_3, upperCase=code_block_18.out1)
code_block_19 = CodeBlock { 0; 0.12; }
domain_3 = Mandrill.Nodes.D3js.BarCharts.Domain(code_block_19.out0, code_block_19.out1)
data_2 = Mandrill.Nodes.D3js.BarCharts.Data(alphabeticalSequence_2, round_3, domain_3)
integer_slider_6 = IntegerSlider(400, range=200..1000 step 1)
integer_slider_7 = IntegerSlider(300, range=300..1000 step 1)
code_block_20 = CodeBlock { "Wall Count"; }
barStyle_2 = Mandrill.Nodes.D3js.BarCharts.BarStyle(byARGB, byARGB_2, integer_slider_6, integer_slider_7, code_block_20)
barChart_2 = Mandrill.Nodes.D3js.BarCharts.BarChart(data_2, barStyle_2)
integer_slider_8 = IntegerSlider(15, range=1..26 step 1)
code_block_21 = CodeBlock { 26; true; }
alphabeticalSequence_3 = Custom[List.AlphabeticalSequence](n=integer_slider_8, upperCase=code_block_21.out1)
code_block_22 = CodeBlock(x=integer_slider_8) { t1 = (0.12..0.12..#x); t2 = 0.01; }
random_4 = Math.Random(code_block_22.t2)
map_4 = List.Map(list=code_block_22.t1, f_x=random_4)
code_block_23 = CodeBlock { 5; }
round_4 = Math.Round(number=map_4, digits=code_block_23)
code_block_24 = CodeBlock { 0; 0.12; }
domain_4 = Mandrill.Nodes.D3js.BarCharts.Domain(code_block_24.out0, code_block_24.out1)
data_3 = Mandrill.Nodes.D3js.BarCharts.Data(alphabeticalSequence_3, round_4, domain_4)
code_block_25 = CodeBlock { "Wall Count"; }
barStyle_3 = Mandrill.Nodes.D3js.BarCharts.BarStyle(byARGB, byARGB_2, integer_slider_6, integer_slider_7, code_block_25)
barChart_3 = Mandrill.Nodes.D3js.BarCharts.BarChart(data_3, barStyle_3)
integer_slider_9 = IntegerSlider(9, range=1..26 step 1)
code_block_26 = CodeBlock { 26; true; }
alphabeticalSequence_4 = Custom[List.AlphabeticalSequence](n=integer_slider_9, upperCase=code_block_26.out1)
code_block_27 = CodeBlock(x=integer_slider_9) { t1 = (0.12..0.12..#x); t2 = 0.01; }
random_5 = Math.Random(code_block_27.t2)
map_5 = List.Map(list=code_block_27.t1, f_x=random_5)
code_block_28 = CodeBlock { 5; }
round_5 = Math.Round(number=map_5, digits=code_block_28)
code_block_29 = CodeBlock { 0; 0.12; }
domain_5 = Mandrill.Nodes.D3js.BarCharts.Domain(code_block_29.out0, code_block_29.out1)
data_4 = Mandrill.Nodes.D3js.BarCharts.Data(alphabeticalSequence_4, round_5, domain_5)
code_block_30 = CodeBlock { "Wall Count"; }
barStyle_4 = Mandrill.Nodes.D3js.BarCharts.BarStyle(byARGB, byARGB_2, integer_slider_6, integer_slider_7, code_block_30)
barChart_4 = Mandrill.Nodes.D3js.BarCharts.BarChart(data_4, barStyle_4)
integer_slider_10 = IntegerSlider(4, range=1..26 step 1)
code_block_31 = CodeBlock { 26; true; }
alphabeticalSequence_5 = Custom[List.AlphabeticalSequence](n=integer_slider_10, upperCase=code_block_31.out1)
code_block_32 = CodeBlock(x=integer_slider_10) { t1 = (0.12..0.12..#x); t2 = 0.01; }
random_6 = Math.Random(code_block_32.t2)
map_6 = List.Map(list=code_block_32.t1, f_x=random_6)
code_block_33 = CodeBlock { 5; }
round_6 = Math.Round(number=map_6, digits=code_block_33)
code_block_34 = CodeBlock { 0; 0.12; }
domain_6 = Mandrill.Nodes.D3js.BarCharts.Domain(code_block_34.out0, code_block_34.out1)
data_5 = Mandrill.Nodes.D3js.BarCharts.Data(alphabeticalSequence_5, round_6, domain_6)
code_block_35 = CodeBlock { "Wall Count"; }
barStyle_5 = Mandrill.Nodes.D3js.BarCharts.BarStyle(byARGB, byARGB_2, integer_slider_6, integer_slider_7, code_block_35)
barChart_5 = Mandrill.Nodes.D3js.BarCharts.BarChart(data_5, barStyle_5)
create_8 = List.Create(barChart_2, barChart_3, barChart_4, barChart_5)
rowContainer_7 = Mandrill.Nodes.Containers.Container.RowContainer(create_8)
create_9 = List.Create(rowContainer, rowContainer_2, rowContainer_4, rowContainer_5, rowContainer_6, rowContainer_7)
watch = Watch(create_9)
maximumItem_4 = List.MaximumItem(round_4)
code_block_36 = CodeBlock { 1; }
code_block_37 = CodeBlock { 0.3; }
maximumItem_5 = List.MaximumItem(round_5)
maximumItem_6 = List.MaximumItem(round_6)
code_block_38 = CodeBlock { 26; true; }
alphabeticalSequence_6 = Custom[List.AlphabeticalSequence](n=integer_slider, upperCase=code_block_38.out1)
code_block_39 = CodeBlock { 0; 0.12; }
domain_7 = Mandrill.Nodes.D3js.BarCharts.Domain(code_block_39.out0, code_block_39.out1)
data_6 = Mandrill.Nodes.D3js.BarCharts.Data(alphabeticalSequence_6, round, domain_7)
code_block_40 = CodeBlock { "Wall Count"; }
barStyle_6 = Mandrill.Nodes.D3js.BarCharts.BarStyle(byARGB, byARGB_2, integer_slider_4, integer_slider_5, code_block_40)
barChart_6 = Mandrill.Nodes.D3js.BarCharts.BarChart(data_6, barStyle_6)
create_10 = List.Create(barChart_6)
watch_2 = Watch(create)
