# Dynamo graph TextNote_sample1.dyn (Dynamo 0.9.1.4062)

code_block = CodeBlock { "Some text"; }
code_block_2 = CodeBlock { 145; Color.ByARGB(255,0,0); }
font_weight = tn_FontWeights("bolder")
font_style = tn_FontStyle("oblique")
font_align = tn_FontAlign("center")
font_transform = tn_FontTransform("none")
textStyle = Mandrill.Nodes.Text.TextBox.TextStyle(code_block_2.out0, code_block_2.out1, font_weight, font_style, font_align, font_transform)
textNote = Mandrill.Nodes.Text.TextBox.TextNote(code_block, textStyle)
create = List.Create(textNote)
rowContainer = Mandrill.Nodes.Containers.Container.RowContainer(create)
create_2 = List.Create(rowContainer)
createReport = Mandrill.Report.CreateReport(create_2)
watch = Watch(textNote)
