# Grasshopper definition barChartOnly.gh (Grasshopper 0.9.76)
# plug-ins: Mandrill

number_slider = Slider(20, range=0..1000)
margins = Margins(Top=20, Bottom=Slider(20, range=0..1000), Right=20, Left=40)
domain = Domain(Start=Slider(0, range=0..100), End=Slider(14, range=0..100))
address = Address(Column=Slider(1, range=0..10), Row=Slider(1, range=0..10))
path = FilePath("E:\Google Drive\Work\Mandrill\_DynamoSamples\BarChart\barChartData.csv")
margins_2 = Margins(Top=number_slider, Bottom=number_slider, Right=number_slider, Left=number_slider)
address_2 = Address(Column=Slider(1, range=0..1), Row=Slider(1, range=0..10))
style = BarChartStyle(
    BarColor=RGB(50, 130, 190),
    BarHoverColor=RGB(255, 0, 0),
    Address=address,
    Margins=margins,
    Width=Slider(412, range=0..10000),
    Height=Slider(600, range=0..1000),
    YAxisLabel="Total Insolation in kWh/m2",
    TickMarksX=Slider(5, range=0..10),
    XTextRotation=Toggle(False))
style_2 = DonutChartStyle(
    HoverColor=RGB(255, 0, 0),
    Address=address_2,
    Margins=margins_2,
    Width=Slider(300, range=0..1000),
    Labels=Toggle(True),
    TotalLabel="SomeTotal")
data = BarChartDataFromCSV(FilePath=path, Domain=domain)
data_2 = DonutChartDataFromCSV(FilePath=path)
chart = DonutChart(Data=data_2, Style=style_2)
bar_chart = BarChart(Data=data, Style=style)
report = CreateReport(A=bar_chart, B=chart)
window = LaunchWindow(Report=report, Show=Toggle(True))
