# Grasshopper definition horizontalbarchart.gh (Grasshopper 0.9.76)
# plug-ins: Mandrill

file_path = FilePath("C:\Users\ksobon\Google Drive\Work\Mandrill\_DynamoSamples\HorizontalBarChart\sampleData.csv")
horizontalbarchartstyle = HorizontalBarChartStyle(BarColor=RGB(50, 130, 190), BarHoverColor=RGB(255, 0, 0), Width=1000, Height=500, XAxisLabel="Label")
horizontalbarchartdatafromcsv = HorizontalBarChartDataFromCSV(FilePath=file_path)
horizontalbarchart = HorizontalBarChart(Data=horizontalbarchartdatafromcsv, Style=horizontalbarchartstyle)
create_report = CreateReport(A=horizontalbarchart)
launchwindow = LaunchWindow(Report=create_report, Show=Toggle(False))
