# Dynamo graph GroupedBarChart_01.dyn (Dynamo 1.2.0.2690)

code_block = CodeBlock()
# ---------- code_block.designscript (4 lines) ----------
{Color.ByARGB(1,0,0,0),
Color.ByARGB(1,50,50,50),
Color.ByARGB(1,100,100,100),
Color.ByARGB(1,150,150,150)};
# ----------------------------------------

# group: Mandrill Logo
file_path = Filename("..\..\_Logo\mandrillLogo-01.png")
integer_slider = IntegerSlider(3, range=1..20 step 1)
integer_slider_2 = IntegerSlider(1, range=1..20 step 1)
address = Charts.MiscNodes.Address(integer_slider, integer_slider_2)
code_block_2 = CodeBlock { 100; 100; }
style = Image.Image.Style(address, code_block_2.out0, code_block_2.out1)
create = Image.Image.Create(file_path, style)

# group: Text
code_block_3 = CodeBlock { "Mandrill Grouped Bar Chart Sample"; }
integer_slider_3 = IntegerSlider(4, range=1..20 step 1)
integer_slider_4 = IntegerSlider(1, range=1..20 step 1)
address_2 = Charts.MiscNodes.Address(integer_slider_3, integer_slider_4)
code_block_4 = CodeBlock { 900; 50; }
font_weight = tn_FontWeight("bold")
style_2 = Text.Text.Style(arg1=address_2, arg2=code_block_4.out0, arg4=code_block_4.out1, arg5=font_weight)
create_2 = Text.Text.Create(code_block_3, style_2)

file_path_2 = Filename(".\Book2.csv")
fromPath = FileObject(file_path_2)  # "File.FromPath"
code_block_5 = CodeBlock { 0; }
integer_slider_5 = IntegerSlider(30, range=0..50 step 5)
domain = Charts.MiscNodes.Domain(code_block_5, integer_slider_5)
dataFromCSV = Charts.GroupedBarChart.DataFromCSV(fromPath, domain)
code_block_6 = CodeBlock { Color.ByARGB(1,255,0,0); }
code_block_7 = CodeBlock { null; }
integer_slider_6 = IntegerSlider(3, range=1..20 step 1)
integer_slider_7 = IntegerSlider(2, range=1..20 step 1)
address_3 = Charts.MiscNodes.Address(integer_slider_6, integer_slider_7)
integer_slider_8 = IntegerSlider(1000, range=1..2000 step 1)
integer_slider_9 = IntegerSlider(400, range=1..2000 step 1)
code_block_8 = CodeBlock { "Count per Floor"; }
style_3 = Charts.GroupedBarChart.Style(code_block_6, code_block_7, address_3, arg4=integer_slider_8, arg5=integer_slider_9, arg6=code_block_8)
chart = Charts.GroupedBarChart.Chart(dataFromCSV, style_3)
create_report = MandrillReportNode(create, create_2, chart)
report_window = MandrillWindowNodeModel(create_report)
