# Dynamo graph lineChart.dyn (Dynamo 1.2.0.2690)

# group: Print PDF
pdf_size = pdf_SizeUI("Letter11x17")
pdf_orientation = pdf_OrientationUI("Landscape")
pdf_fit_mode = pdf_FitModeUI("AutoFit")
code_block = CodeBlock { 0; }
PDFStyle = Report.Pdf.PDFStyle(pdf_size, pdf_orientation, pdf_fit_mode, pdf_fit_mode, code_block)
file_path = Filename("E:\Google Drive\Presentations_Workshops\2016 - AIA Presentation\JPG\areaChartExport.pdf")
saveAsPDF = Report.Pdf.SaveAsPDF(arg1=PDFStyle, arg2=file_path)  # unwired: arg0

# group: Mandrill Logo
file_path_2 = Filename("..\..\_Logo\mandrillLogo-01.png")
integer_slider = IntegerSlider(3, range=1..20 step 1)
integer_slider_2 = IntegerSlider(1, range=1..20 step 1)
address = Charts.MiscNodes.Address(integer_slider, integer_slider_2)
code_block_2 = CodeBlock { 100; 100; }
style = Image.Image.Style(address, code_block_2.out0, code_block_2.out1)
create = Image.Image.Create(file_path_2, style)

create_report = MandrillReportNode(create)  # unwired: arg1, arg2
report_chrome_window = MandrillChromeWindowNodeModel(create_report)

# group: Text
code_block_3 = CodeBlock { "Mandrill Line Chart Sample"; }
integer_slider_3 = IntegerSlider(4, range=1..20 step 1)
integer_slider_4 = IntegerSlider(1, range=1..20 step 1)
address_2 = Charts.MiscNodes.Address(integer_slider_3, integer_slider_4)
code_block_4 = CodeBlock { 700; 50; }
font_weight = tn_FontWeight("bold")
style_2 = Text.Text.Style(arg1=address_2, arg2=code_block_4.out0, arg4=code_block_4.out1, arg5=font_weight)
create_2 = Text.Text.Create(code_block_3, style_2)

file_path_3 = Filename("..\AreaChart\AreaChart.csv")
code_block_5 = CodeBlock { 0; 650; }
domain = Charts.MiscNodes.Domain(code_block_5.out0, code_block_5.out1)
dataFromCSV = Charts.LineChart.DataFromCSV(file_path_3, domain)
integer_slider_5 = IntegerSlider(3, range=1..20 step 1)
integer_slider_6 = IntegerSlider(2, range=1..20 step 1)
address_3 = Charts.MiscNodes.Address(integer_slider_5, integer_slider_6)
code_block_6 = CodeBlock { Color.ByARGB(1,100,100,100); 1400; 600; "Label"; 4; }
style_3 = Charts.LineChart.Style(arg1=address_3, arg3=code_block_6.out1, arg4=code_block_6.out2, arg5=code_block_6.out3, arg6=code_block_6.out4)
chart = Charts.LineChart.Chart(dataFromCSV, style_3)
create_report_2 = MandrillReportNode(chart)
report_window = MandrillWindowNodeModel(create_report_2)
