# Dynamo graph normalizedStackedBarChart.dyn (Dynamo 1.2.0.2690)

file_path = Filename("..\GroupedBarChart\Book2.csv")
dataFromCSV = Charts.NormalizedStackedBarChart.DataFromCSV(file_path)
color_picker = nColorPicker()
style = Charts.NormalizedStackedBarChart.Style(color_picker)
chart = Charts.NormalizedStackedBarChart.Chart(dataFromCSV, style)
create_report = MandrillReportNode(chart)
report_window = MandrillWindowNodeModel(create_report)
