# Dynamo graph parallelCoordinates.dyn (Dynamo 1.2.0.2654)

# group: PDF Print
pdf_size = pdf_SizeUI("A0")
pdf_orientation = pdf_OrientationUI("Landscape")
pdf_fit_mode = pdf_FitModeUI("AutoFit")
PDFStyle = Report.Pdf.PDFStyle(pdf_size, pdf_orientation, pdf_fit_mode, pdf_fit_mode)
file_path = Filename("..\..\..\..\..\Desktop\test.pdf")
saveAsPDF = Report.Pdf.SaveAsPDF(arg1=PDFStyle, arg2=file_path)  # unwired: arg0
watch = Watch(saveAsPDF)

# group: Mandrill Logo
file_path_2 = Filename("..\..\_Logo\mandrillLogo-01.png")
integer_slider = IntegerSlider(3, range=1..20 step 1)
integer_slider_2 = IntegerSlider(1, range=1..20 step 1)
address = Charts.MiscNodes.Address(integer_slider, integer_slider_2)
code_block = CodeBlock { 100; 100; }
style = Image.Image.Style(address, code_block.out0, code_block.out1)
create = Image.Image.Create(file_path_2, style)

# group: Text
code_block_2 = CodeBlock { "Mandrill Parallel Coordinates Chart Sample"; }
integer_slider_3 = IntegerSlider(4, range=1..20 step 1)
integer_slider_4 = IntegerSlider(1, range=1..20 step 1)
address_2 = Charts.MiscNodes.Address(integer_slider_3, integer_slider_4)
code_block_3 = CodeBlock { 1000; 50; }
font_weight = tn_FontWeight("bold")
style_2 = Text.Text.Style(arg1=address_2, arg2=code_block_3.out0, arg4=code_block_3.out1, arg5=font_weight)
create_2 = Text.Text.Create(code_block_2, style_2)

file_path_3 = Filename(".\parallelCoordinatesData.csv")
fromPath = FileObject(file_path_3)  # "File.FromPath"
dataFromCSV = Charts.ParallelCoordinates.DataFromCSV(fromPath)
number_slider = DoubleSlider(2, range=1..20 step 1)
number_slider_2 = DoubleSlider(2, range=1..20 step 1)
address_3 = Charts.MiscNodes.Address(number_slider, number_slider_2)
code_block_4 = CodeBlock { 1500; 600; }
style_3 = Charts.ParallelCoordinates.Style(arg1=address_3, arg2=code_block_4.out0, arg3=code_block_4.out1)
chart = Charts.ParallelCoordinates.Chart(dataFromCSV, style_3)
create_report = MandrillReportNode(create, create_2, chart)
report_chrome_window = MandrillChromeWindowNodeModel(create_report)
