# Dynamo graph areaChart.dyn (Dynamo 1.2.1.3083)

file_path = Filename(".\AreaChart.csv")
code_block = CodeBlock { 0; 650; }
domain = Charts.MiscNodes.Domain(code_block.out0, code_block.out1)
dataFromCSV = Charts.AreaChart.DataFromCSV(file_path, domain)
color_picker = nColorPicker()
code_block_2 = CodeBlock { 3; 1; }
address = Charts.MiscNodes.Address(code_block_2.out0, code_block_2.out1)
integer_slider = IntegerSlider(10, range=0..100 step 1)
integer_slider_2 = IntegerSlider(20, range=0..100 step 1)
margins = Charts.MiscNodes.Margins(integer_slider, integer_slider, integer_slider_2, integer_slider_2)
code_block_3 = CodeBlock { 1400; 600; "Label"; 10; }
style = Charts.AreaChart.Style(color_picker, address, margins, code_block_3.out0, code_block_3.out1, code_block_3.out2, code_block_3.out3)  # unwired: arg7
chart = Charts.AreaChart.Chart(dataFromCSV, style)
create_report = MandrillReportNode(chart)
report_window = MandrillWindowNodeModel(create_report)
file_path_2 = Filename("C:\Users\ksobon\Desktop\testExport.pdf")
pdf_size = pdf_SizeUI("Letter11x17")
pdf_orientation = pdf_OrientationUI("Landscape")
pdf_fit_mode = pdf_FitModeUI("AutoFit")
style_2 = Report.Pdf.Style(pdf_size, pdf_orientation, pdf_fit_mode, pdf_fit_mode)
print_to_pdf = MandrillPrintNodeModel(file_path_2, create_report, style_2)
code_block_4 = CodeBlock { {"A","B","C","D","E"}; {1,12,13,1,15}; }
code_block_5 = CodeBlock { 0; 16; }
domain_2 = Charts.MiscNodes.Domain(code_block_5.out0, code_block_5.out1)
data = Charts.AreaChart.Data(code_block_4.out0, code_block_4.out1, domain_2)
code_block_6 = CodeBlock { 1400; 600; "Label"; 4; }
code_block_7 = CodeBlock { 6.0; }
style_3 = Charts.AreaChart.Style(arg3=code_block_6.out0, arg4=code_block_6.out1, arg5=code_block_6.out2, arg6=code_block_6.out3, arg7=code_block_7)
chart_2 = Charts.AreaChart.Chart(data, style_3)
create_report_2 = MandrillReportNode(chart_2)
report_window_2 = MandrillWindowNodeModel(create_report_2)
