# Dynamo graph barChart_01.dyn (Dynamo 1.3.0.875)

code_block = CodeBlock { {"A", "B", "C"}; {1,20,10}; }
code_block_2 = CodeBlock { 0; 30; }
domain = Charts.MiscNodes.Domain(code_block_2.out0, code_block_2.out1)
data = Charts.BarChart.Data(code_block.out0, code_block.out1, domain)
code_block_3 = CodeBlock { 2; }
boolean = BoolSelector(true)
style = Charts.BarChart.Style(arg7=code_block_3, arg9=boolean)
chart = Charts.BarChart.Chart(data, style)
create_report = MandrillReportNode(chart)
report_window = MandrillWindowNodeModel(create_report)
file_path = Filename(".\Level1.csv")
code_block_4 = CodeBlock { 0; 16; }
domain_2 = Charts.MiscNodes.Domain(code_block_4.out0, code_block_4.out1)
dataFromCSV = Charts.BarChart.DataFromCSV(file_path, domain_2)
color_picker = nColorPicker()
color_picker_2 = nColorPicker()
code_block_5 = CodeBlock { 1; 6; }
address = Charts.MiscNodes.Address(code_block_5.out0, code_block_5.out1)
integer_slider = IntegerSlider(18, range=0..100 step 1)
integer_slider_2 = IntegerSlider(80, range=0..100 step 1)
margins = Charts.MiscNodes.Margins(integer_slider, integer_slider_2, integer_slider, integer_slider)
code_block_6 = CodeBlock { 1500; 600; "Wall Count"; 13; true; }
boolean_2 = BoolSelector(true)
style_2 = Charts.BarChart.Style(color_picker, color_picker_2, address, margins, code_block_6.out0, code_block_6.out1, code_block_6.out2, code_block_6.out3, code_block_6.out4, boolean_2)
chart_2 = Charts.BarChart.Chart(dataFromCSV, style_2)
create_report_2 = MandrillReportNode(chart, chart_2)
report_window_2 = MandrillWindowNodeModel(create_report_2)
file_path_2 = Filename("C:\Users\ksobon\Desktop\testPrint.pdf")
pdf_size = pdf_SizeUI("Letter11x17")
pdf_fit_mode = pdf_FitModeUI("AutoFit")
style_3 = Report.Pdf.Style(pdf_size, arg2=pdf_fit_mode, arg3=pdf_fit_mode)
print_to_pdf = MandrillPrintNodeModel(file_path_2, create_report_2, style_3)
report_window_3 = MandrillWindowNodeModel()  # unwired: arg0, arg1
boolean_3 = BoolSelector(false)
report_window_4 = MandrillWindowNodeModel(create_report, boolean_3)
