# Dynamo graph gridsterBarChart.dyn (Dynamo 1.2.0.2654)

file_path = Filename("E:\Google Drive\Work\Mandrill\_DynamoSamples\BarChart\barChartData.csv")
code_block = CodeBlock { 0; 20; }
domain = Charts.MiscNodes.Domain(code_block.out0, code_block.out1)
dataFromCSV = Charts.BarChart.DataFromCSV(file_path, domain)
code_block_2 = CodeBlock { 1; 1; }
address = Charts.MiscNodes.Address(code_block_2.out0, code_block_2.out1)
code_block_3 = CodeBlock { 1800; 600; }
code_block_4 = CodeBlock { 9; }
style = Charts.BarChart.Style(arg2=address, arg3=code_block_3.out0, arg4=code_block_3.out1, arg6=code_block_4)
chart = Charts.BarChart.Chart(dataFromCSV, style)
dataFromCSV_2 = Charts.BarChart.DataFromCSV(file_path, domain)
code_block_5 = CodeBlock { 6; 7; }
address_2 = Charts.MiscNodes.Address(code_block_5.out0, code_block_5.out1)
code_block_6 = CodeBlock { 500; 200; }
style_2 = Charts.BarChart.Style(arg2=address_2, arg3=code_block_6.out0, arg4=code_block_6.out1, arg6=code_block_4)
chart_2 = Charts.BarChart.Chart(dataFromCSV_2, style_2)
create_report = MandrillReportNode(chart_2)
report_chrome_window = MandrillChromeWindowNodeModel(create_report)
dataFromCSV_3 = Charts.BarChart.DataFromCSV(file_path, domain)
code_block_7 = CodeBlock { 11; 1; }
address_3 = Charts.MiscNodes.Address(code_block_7.out0, code_block_7.out1)
style_3 = Charts.BarChart.Style(arg2=address_3, arg3=code_block_6.out0, arg4=code_block_6.out1, arg6=code_block_4)
chart_3 = Charts.BarChart.Chart(dataFromCSV_3, style_3)
