# Dynamo graph testForNewModel.dyn (Dynamo 1.2.0.2690)

file_path = Filename("C:\Users\ksobon\Google Drive\Work\Mandrill\_DynamoSamples\BarChart\barChartData.csv")
dataFromCSV = Charts.BarChart.DataFromCSV(file_path)
style = Charts.BarChart.Style()
chart = Charts.BarChart.Chart(dataFromCSV, style)
create_report = MandrillReportNode(chart)
watch = Watch(create_report)
report_window = MandrillWindowNodeModel(create_report)
