# Dynamo graph donutChartSample.dyn (Dynamo 1.2.0.2690)

code_block = CodeBlock()
# ---------- code_block.designscript (6 lines) ----------
{"Sample Data 1",
"Sample Data 2",
"Sample Data 3",
"Sample Data 4",
"Sample Data 5"};
{1000,100,200,100,100};
# ----------------------------------------
data = Charts.DonutChart.Data(code_block.out0, code_block.out1)
file_path = Filename(".\donutChartData.csv")
fromPath = FileObject(file_path)  # "File.FromPath"
dataFromCSV = Charts.DonutChart.DataFromCSV(fromPath)
color_picker = nColorPicker()
color_picker_2 = nColorPicker()
color_picker_3 = nColorPicker()
color_picker_4 = nColorPicker()
color_picker_5 = nColorPicker()
color_picker_6 = nColorPicker()
create = List.Create(color_picker_2, color_picker_3, color_picker_4, color_picker_5, color_picker_6)
code_block_2 = CodeBlock { 6; 1; }
address = Charts.MiscNodes.Address(code_block_2.out0, code_block_2.out1)
integer_slider = IntegerSlider(75, range=0..100 step 1)
margins = Charts.MiscNodes.Margins(integer_slider, integer_slider, integer_slider, integer_slider)
integer_slider_2 = IntegerSlider(500, range=0..500 step 1)
code_block_3 = CodeBlock { true; "TOTAL"; }
style = Charts.DonutChart.Style(color_picker, create, address, margins, integer_slider_2, code_block_3.out0, code_block_3.out1)
chart = Charts.DonutChart.Chart(dataFromCSV, style)
create_report = MandrillReportNode(chart)
report_window = MandrillWindowNodeModel(create_report)
code_block_4 = CodeBlock()
# ---------- code_block_4.designscript (5 lines) ----------
{"Sample Data 1",
"Sample Data 2",
"Sample Data 3",
"Sample Data 4",
"Sample Data 5"};
# ----------------------------------------
data_2 = Legends.Legend.Data(code_block_4)
color_picker_7 = nColorPicker()
color_picker_8 = nColorPicker()
color_picker_9 = nColorPicker()
color_picker_10 = nColorPicker()
color_picker_11 = nColorPicker()
create_2 = List.Create(color_picker_7, color_picker_8, color_picker_9, color_picker_10, color_picker_11)
code_block_5 = CodeBlock { 150; }
code_block_6 = CodeBlock { "Some Title"; }
integer_slider_3 = IntegerSlider(30, range=1..50 step 1)
style_2 = Legends.Legend.Style(create_2, arg2=code_block_5, arg4=code_block_6, arg5=integer_slider_3)
create_3 = Legends.Legend.Create(data_2, style_2)
create_report_2 = MandrillReportNode(create_3)
report_window_2 = MandrillWindowNodeModel(create_report_2)
