# Dynamo graph gBubble_01.dyn (Dynamo 1.2.1.3083)

code_block = CodeBlock()
# ---------- code_block.designscript (6 lines) ----------
{"Group.Squares.Square1",
"Group.Squares.Square2",
"Group.Circles.Circle1",
"Group.Circles.Circle2",
"Group.Triangles.Triangle1",
"Group.Triangles.Triangle2"};
# ----------------------------------------
code_block_2 = CodeBlock()
# ---------- code_block_2.designscript (3 lines) ----------
{12,2,
32,33,
4,12};
# ----------------------------------------
code_block_3 = CodeBlock { {1,1,2,2,3,3}; }
data = Charts.GroupedBubbleChart.Data(code_block, code_block_2, code_block_3)
boolean = BoolSelector(true)
dataToJson = Charts.MiscNodes.DataToJson(data, boolean)
watch = Watch(dataToJson)
