# Dynamo graph horizontalBarChart.dyn (Dynamo 1.2.0.2690)

file_path = Filename(".\sampleData.csv")
code_block = CodeBlock { 0; 90; }
domain = Charts.MiscNodes.Domain(code_block.out0, code_block.out1)
dataFromCSV = Charts.HorizontalBarChart.DataFromCSV(file_path, domain)
code_block_2 = CodeBlock()
# ---------- code_block_2.designscript (6 lines) ----------
{"Some really long name 1",
"Some really long name 2",
"Some really long name 3",
"Some really long name 4"};
{10, 12, 16, 3};
{0,1,1,2};
# ----------------------------------------
code_block_3 = CodeBlock { 0; 20; }
domain_2 = Charts.MiscNodes.Domain(code_block_3.out0, code_block_3.out1)
data = Charts.HorizontalBarChart.Data(code_block_2.out0, code_block_2.out1, code_block_2.out2, domain_2)
color_picker = nColorPicker()
color_picker_2 = nColorPicker()
color_picker_3 = nColorPicker()
color_picker_4 = nColorPicker()
create = List.Create(color_picker, color_picker_2, color_picker_3, color_picker_4)
code_block_4 = CodeBlock { 1; 1; }
address = Charts.MiscNodes.Address(code_block_4.out0, code_block_4.out1)
integer_slider = IntegerSlider(119, range=0..200 step 1)
margins = Charts.MiscNodes.Margins(arg3=integer_slider)
code_block_5 = CodeBlock { 1000; 500; "SomeLabel"; }
style = Charts.HorizontalBarChart.Style(create, arg2=address, arg3=margins, arg4=code_block_5.out0, arg5=code_block_5.out1, arg6=code_block_5.out2)
chart = Charts.HorizontalBarChart.Chart(data, style)
create_report = MandrillReportNode(chart)
report_window = MandrillWindowNodeModel(create_report)
file_path_2 = Filename(".\testPrint.pdf")
pdf_size = pdf_SizeUI("Letter11x17")
pdf_orientation = pdf_OrientationUI("Landscape")
pdf_fit_mode = pdf_FitModeUI("AutoFit")
code_block_6 = CodeBlock { 1; }
style_2 = Report.Pdf.Style(pdf_size, pdf_orientation, pdf_fit_mode, pdf_fit_mode, code_block_6)
print_to_pdf = MandrillPrintNodeModel(file_path_2, style_2)  # unwired: arg2
file_path_3 = Filename("..\..\..\..\..\..\Desktop\testExport.html")
save_to_html = MandrillHtmlNodeModel(file_path_3, create_report)
