# Dynamo graph images_01.dyn (Dynamo 1.2.0.2690)

code_block = CodeBlock { "Mandrill Plugin"; }
integer_slider = IntegerSlider(79, range=1..1000 step 1)
font_weight = tn_FontWeight("bold")
style = Text.Text.Style(arg2=integer_slider, arg5=font_weight)
create = Text.Text.Create(code_block, style)
code_block_2 = CodeBlock { ""; }
style_2 = Text.Text.Style()  # unwired: arg6, arg7
create_2 = Text.Text.Create(code_block_2, style_2)
code_block_3 = CodeBlock { ""; }
style_3 = Text.Text.Style()  # unwired: arg6, arg7
create_3 = Text.Text.Create(code_block_3, style_3)
file_path = Filename("..\..\..\_Logo\mandrillLogo-01.png")
integer_slider_2 = IntegerSlider(150, range=1..1000 step 1)
integer_slider_3 = IntegerSlider(150, range=1..1000 step 1)
style_4 = Image.Image.Style(arg1=integer_slider_2, arg2=integer_slider_3)
create_4 = Image.Image.Create(file_path, style_4)
create_report = MandrillReportNode(create_4)
report_window = MandrillWindowNodeModel(create_report)
