# Dynamo graph legend.dyn (Dynamo 1.2.0.2654)

file_path = Filename("..\DonutChart\donutChartData.csv")
fromPath = FileObject(file_path)  # "File.FromPath"
readFromFile = CSV.ReadFromFile(fromPath)
code_block = CodeBlock { 1; }
dropItems = List.DropItems(list=readFromFile, amount=code_block)
code_block_2 = CodeBlock { 0; }
getItemAtIndex = List.GetItemAtIndex(list=dropItems@L2, index=code_block_2)
data = Legends.Legend.Data(getItemAtIndex)
integer_slider = IntegerSlider(12, range=1..20 step 1)
integer_slider_2 = IntegerSlider(3, range=1..20 step 1)
address = Charts.MiscNodes.Address(integer_slider, integer_slider_2)
number_slider = DoubleSlider(120, range=1..500 step 1)
number_slider_2 = DoubleSlider(200, range=1..500 step 1)
code_block_3 = CodeBlock { "SomeTitle"; 30; }
style = Legends.Legend.Style(arg1=address, arg2=number_slider, arg3=number_slider_2, arg4=code_block_3.out0, arg5=code_block_3.out1)
create = Legends.Legend.Create(data, style)
dataFromCSV = Charts.DonutChart.DataFromCSV(file_path)
integer_slider_3 = IntegerSlider(7, range=1..20 step 1)
integer_slider_4 = IntegerSlider(3, range=1..20 step 1)
address_2 = Charts.MiscNodes.Address(integer_slider_3, integer_slider_4)
code_block_4 = CodeBlock { 400; 50; }
boolean = BoolSelector(true)
code_block_5 = CodeBlock { "test"; }
style_2 = Charts.DonutChart.Style(arg2=address_2, arg3=code_block_4.out0, arg4=code_block_4.out1, arg5=boolean, arg6=code_block_5)
chart = Charts.DonutChart.Chart(dataFromCSV, style_2)
create_report = MandrillReportNode(create, chart)
report_window = MandrillWindowNodeModel(create_report)
