# Dynamo graph normalizedStackedBarChart.dyn (Dynamo 1.2.0.2690)

file_path = Filename("..\GroupedBarChart\Book2.csv")
dataFromCSV = Charts.NormalizedStackedBarChart.DataFromCSV(file_path)
code_block = CodeBlock()
# ---------- code_block.designscript (5 lines) ----------
{"Name","Value1", "Value2", "Value3"};
{{"Stack1", 1,12,22},
{"Stack2", 2,22,3},
{"Stack3", 33,22,1},
{"Stack4", 21,1,2}};
# ----------------------------------------
data = Charts.NormalizedStackedBarChart.Data(code_block.out0, code_block.out1)
color_picker = nColorPicker()
color_picker_2 = nColorPicker()
color_picker_3 = nColorPicker()
color_picker_4 = nColorPicker()
create = List.Create(color_picker_2, color_picker_3, color_picker_4)
code_block_2 = CodeBlock { 1; 3; }
address = Charts.MiscNodes.Address(code_block_2.out0, code_block_2.out1)
margins = Charts.MiscNodes.Margins()
code_block_3 = CodeBlock { "Vertical Label"; }
style = Charts.NormalizedStackedBarChart.Style(color_picker, create, address, margins, arg6=code_block_3)
chart = Charts.NormalizedStackedBarChart.Chart(data, style)
create_report = MandrillReportNode(chart)
report_window = MandrillWindowNodeModel(create_report)
