# Dynamo graph parallelCoordinates.dyn (Dynamo 1.3.0.875)

# group: Text
code_block = CodeBlock { "Mandrill Parallel Coordinates Chart Sample"; }
integer_slider = IntegerSlider(4, range=1..20 step 1)
integer_slider_2 = IntegerSlider(1, range=1..20 step 1)
address = Charts.MiscNodes.Address(integer_slider, integer_slider_2)
code_block_2 = CodeBlock { 1000; 50; }
font_weight = tn_FontWeight("bold")
style = Text.Text.Style(arg1=address, arg2=code_block_2.out0, arg4=code_block_2.out1, arg5=font_weight)
create = Text.Text.Create(code_block, style)

# group: Mandrill Logo
file_path = Filename("..\..\_Logo\mandrillLogo-01.png")
integer_slider_3 = IntegerSlider(3, range=1..20 step 1)
integer_slider_4 = IntegerSlider(1, range=1..20 step 1)
address_2 = Charts.MiscNodes.Address(integer_slider_3, integer_slider_4)
code_block_3 = CodeBlock { 100; 100; }
style_2 = Image.Image.Style(address_2, code_block_3.out0, code_block_3.out1)
create_2 = Image.Image.Create(file_path, style_2)

code_block_4 = CodeBlock()
# ---------- code_block_4.designscript (4 lines) ----------
{"name", "A", "B", "C"};
{{"test1", 1, 2, 2},
{"test2", 12, 22, 11},
{"test3", 11, 22, 33}};
# ----------------------------------------
data = Charts.ParallelCoordinates.Data(code_block_4.out0, code_block_4.out1)
file_path_2 = Filename("..\..\..\..\..\..\Downloads\asd (2).csv")
fromPath = FileObject(file_path_2)  # "File.FromPath"
dataFromCSV = Charts.ParallelCoordinates.DataFromCSV(fromPath)
color_picker = nColorPicker()
code_block_5 = CodeBlock { 2; 2; }
address_3 = Charts.MiscNodes.Address(code_block_5.out0, code_block_5.out1)
code_block_6 = CodeBlock { 40; 20; }
margins = Charts.MiscNodes.Margins(code_block_6.out1, code_block_6.out1, code_block_6.out1, code_block_6.out0)
code_block_7 = CodeBlock { 1500; 600; }
style_3 = Charts.ParallelCoordinates.Style(color_picker, address_3, margins, code_block_7.out0, code_block_7.out1)
chart = Charts.ParallelCoordinates.Chart(dataFromCSV, style_3)
create_report = MandrillReportNode(chart)
boolean = BoolSelector(true)
report_window = MandrillWindowNodeModel(create_report, boolean)
