# Dynamo graph PieChart.dyn (Dynamo 1.2.0.2690)

data = Charts.PieChart.Data()  # unwired: arg0, arg1
file_path = Filename("..\DonutChart\donutChartData.csv")
dataFromCSV = Charts.PieChart.DataFromCSV(file_path)
code_block = CodeBlock { 100; }
margins = Charts.MiscNodes.Margins(code_block, code_block, code_block, code_block)
code_block_2 = CodeBlock { 500; }
style = Charts.PieChart.Style(arg3=margins, arg4=code_block_2)
chart = Charts.PieChart.Chart(dataFromCSV, style)
create_report = MandrillReportNode(chart)
report_window = MandrillWindowNodeModel(create_report)
