# Dynamo graph scatterPlotMatrix.dyn (Dynamo 1.2.0.2654)

data = Charts.ScatterPlotMatrix.Data()  # unwired: arg0, arg1
file_path = Filename("C:\Users\ksobon\Google Drive\Work\Mandrill\_DynamoSamples\ScaterPlotMatrix\scatterPlotMatrixData.csv")
dataFromCSV = Charts.ScatterPlotMatrix.DataFromCSV(file_path)
style = Charts.ScatterPlotMatrix.Style()
chart = Charts.ScatterPlotMatrix.Chart(dataFromCSV, style)
create_report = MandrillReportNode(chart)
report_window = MandrillWindowNodeModel(create_report)
