# Dynamo graph scatterPlotMatrixData.dyn (Dynamo 1.2.0.2690)

file_path = Filename(".\scatterPlotMatrixData.csv")
dataFromCSV = Charts.ScatterPlotMatrix.DataFromCSV(file_path)
code_block = CodeBlock()
# ---------- code_block.designscript (6 lines) ----------
{"Name", "Value1", "Value2", "Value3"};
{{"Group2", 8, 2, 3},
{"Group1", 22,21,12},
{"Group1", 2,11,33},
{"Group1", 6, 5,8},
{"Group1", 2, 8,7}};
# ----------------------------------------
data = Charts.ScatterPlotMatrix.Data(code_block.out0, code_block.out1)
integer_slider = IntegerSlider(5, range=1..20 step 1)
integer_slider_2 = IntegerSlider(1, range=1..20 step 1)
address = Charts.MiscNodes.Address(integer_slider, integer_slider_2)
integer_slider_3 = IntegerSlider(726, range=1..1000 step 1)
style = Charts.ScatterPlotMatrix.Style(arg1=address, arg2=integer_slider_3)
chart = Charts.ScatterPlotMatrix.Chart(data, style)
create_report = MandrillReportNode(chart)
report_window = MandrillWindowNodeModel(create_report)
color_picker = nColorPicker()
color_picker_2 = nColorPicker()
color_picker_3 = nColorPicker()
color_picker_4 = nColorPicker()
color_picker_5 = nColorPicker()
create = List.Create(color_picker, color_picker_2, color_picker_3, color_picker_4, color_picker_5)
