# Dynamo graph StackedBarChart_01.dyn (Dynamo 1.2.0.2690)

code_block = CodeBlock { 1; }

# group: Plot to PDF
pdf_size = pdf_SizeUI("ArchD")
pdf_orientation = pdf_OrientationUI("Landscape")
pdf_fit_mode = pdf_FitModeUI("ShrinkOnly")
PDFStyle = Report.Pdf.PDFStyle(pdf_size, pdf_orientation, pdf_fit_mode, pdf_fit_mode, code_block)
file_path = Filename("C:\Users\ksobon\Desktop\testPrint.pdf")
saveAsPDF = Report.Pdf.SaveAsPDF(arg1=PDFStyle, arg2=file_path)  # unwired: arg0

# group: Mandrill Logo
file_path_2 = Filename("..\..\_Logo\mandrillLogo-01.png")
integer_slider = IntegerSlider(3, range=1..20 step 1)
integer_slider_2 = IntegerSlider(1, range=1..20 step 1)
address = Charts.MiscNodes.Address(integer_slider, integer_slider_2)
code_block_2 = CodeBlock { 100; 100; }
style = Image.Image.Style(address, code_block_2.out0, code_block_2.out1)
create = Image.Image.Create(file_path_2, style)

# group: Text
code_block_3 = CodeBlock { "Mandrill Stacked Bar Chart Sample"; }
integer_slider_3 = IntegerSlider(4, range=1..20 step 1)
integer_slider_4 = IntegerSlider(1, range=1..20 step 1)
address_2 = Charts.MiscNodes.Address(integer_slider_3, integer_slider_4)
code_block_4 = CodeBlock { 800; 50; }
font_weight = tn_FontWeight("bold")
style_2 = Text.Text.Style(arg1=address_2, arg2=code_block_4.out0, arg4=code_block_4.out1, arg5=font_weight)
create_2 = Text.Text.Create(code_block_3, style_2)

file_path_3 = Filename("..\GroupedBarChart\Book2.csv")
fromPath = FileObject(file_path_3)  # "File.FromPath"
code_block_5 = CodeBlock { 0; 50; }
domain = Charts.MiscNodes.Domain(code_block_5.out0, code_block_5.out1)
dataFromCSV = Charts.StackedBarChart.DataFromCSV(fromPath, domain)
color_picker = nColorPicker()
code_block_6 = CodeBlock { null; }
integer_slider_5 = IntegerSlider(3, range=1..20 step 1)
integer_slider_6 = IntegerSlider(2, range=1..20 step 1)
address_3 = Charts.MiscNodes.Address(integer_slider_5, integer_slider_6)
integer_slider_7 = IntegerSlider(1400, range=1..2000 step 1)
integer_slider_8 = IntegerSlider(600, range=1..2000 step 1)
code_block_7 = CodeBlock { "Count per Floor"; }
style_3 = Charts.StackedBarChart.Style(color_picker, code_block_6, address_3, arg4=integer_slider_7, arg5=integer_slider_8, arg6=code_block_7)
chart = Charts.StackedBarChart.Chart(dataFromCSV, style_3)
create_report = MandrillReportNode(chart)
report_window = MandrillWindowNodeModel(create_report)
