# Grasshopper definition barChart.gh (Grasshopper 0.9.76)
# plug-ins: Mandrill

panel = Panel("""Name1
6
14
22""")
panel_2 = Panel("""Name2
2
12
22""")
panel_3 = Panel("""Name3
2
12
22""")
number_slider = Slider(300, range=1..2000)
number_slider_2 = Slider(900, range=1..2000)
address = Address(Column=Slider(1, range=1..20), Row=Slider(5, range=1..20))
path = FilePath("E:\Google Drive\Work\Mandrill\_DynamoSamples\BarChart\barChartData.csv")
panel_4 = Panel("""Names
Header1
Header2
Header3""")
entwine = Entwine(Branch00=panel, Branch01=panel_2, Branch02=panel_3, FlattenInputs=True)  # -> simplify(Result)
address_2 = Address(Column=Slider(2, range=1..20), Row=Slider(5, range=1..20))
address_3 = Address(Column=Slider(8, range=1..20), Row=Slider(5, range=1..20))
address_4 = Address(Column=Slider(5, range=1..20), Row=Slider(5, range=1..20))
path_2 = FilePath("E:\Google Drive\Work\Mandrill\_Logo\mandrillLogo1-01.png")
domain = Domain(Start="0", End="16")
domain_2 = Domain(Start="0", End="50")
style = ImageStyle(Address=address, Width=Slider(400, range=0..1000), Height=Slider(100, range=0..1000))
path_3 = FilePath("E:\Google Drive\Work\Mandrill\_DynamoSamples\GroupedBarChart\Book2.csv")
style_2 = AreaChartStyle(
    AreaColor=RGB(50, 130, 190),
    Address=address_4,
    Width=number_slider_2,
    Height=number_slider,
    YAxisLabel="Label",
    TickMarksX="9")
image = Image(FilePath=path_2, Style=style)
data = BarChartDataFromCSV(FilePath=path, Domain=domain)
style_3 = BarChartStyle(
    BarColor=RGB(50, 130, 190),
    BarHoverColor=RGB(255, 0, 0),
    Address=address_2,
    Width=number_slider_2,
    Height=number_slider,
    YAxisLabel="BarChart",
    TickMarksX="9",
    XTextRotation=Toggle(False))
data_2 = AreaChartDataFromCSV(FilePath=path, Domain=domain)
style_4 = StackedBarChartStyle(BarHoverColor=RGB(255, 0, 0), Address=address_3, Width=number_slider_2, Height=number_slider, YAxisLabel="Label")
data_3 = StackedBarChartDataFromCSV(FilePath=path_3, Domain=domain_2)
data_4 = StackedBarChartData(Headers=panel_4, Values=entwine, Domain=domain_2)
chart = StackedBarChart(Data=data_3, Style=style_4)
chart_2 = AreaChart(Data=data_2, Style=style_2)
bar_chart = BarChart(Data=data, Style=style_3)
report = CreateReport(A=bar_chart, B=chart_2, C=chart, D=image)
fitmode = PdfFitMode({"NoAdjustment": 0, "ShrinkOnly": 1, "AutoFit": 2}, selected="AutoFit")
orientation = PdfOrientation({"Portrait": 0, "Landscape": 1}, selected="Landscape")
size = PdfSize({"Custom": 0, "Letter": 1, "Note": 2, "Legal": 3, "A0": 4, "A1": 5, "A2": 6, "A3": 7, "A4": 8, "A5": 9, "A6": 10, "A7": 11, "A8": 12, "A9": 13, "A10": 14, "B0": 15, "B1": 16, "B2": 17, "B3": 18, "B4": 19, "B5": 20, "ArchE": 21, "ArchD": 22, "ArchC": 23, "ArchB": 24, "ArchA": 25, "Flsa": 26, "HalfLetter": 27, "Letter11x17": 28, "Ledger": 29}, selected="ArchE")
window = LaunchWindow(Report=report, Show=Toggle(True))
panel_5 = Panel("C:\Users\ksobon\Desktop\GooglePrints\testPrints\testPrint.pdf")
style_5 = PdfStyle(
    PdfSize=size,
    PdfOrientation=orientation,
    PdfHorizontalFit=fitmode,
    PdfVerticalFit=fitmode,
    Compression=10,
    MarginTop=0,
    MarginRight=0,
    MarginBottom=0,
    MarginLeft=0)
pdf = PrintToPdf(FilePath=panel_5, Style=style_5, Print=Toggle(False))
