# Grasshopper definition barChartOnly.gh (Grasshopper 0.9.76)
# plug-ins: Mandrill

margins = Margins(Top=20, Bottom=Slider(131, range=0..1000), Right=20, Left=40)
domain = Domain(Start=Slider(0, range=0..100), End=Slider(16, range=0..100))
address = Address(Column=Slider(1, range=0..10), Row=Slider(3, range=0..10))
path = FilePath("E:\Google Drive\Work\Mandrill\_Samples\Dynamo\BarChart\Level1 - Copy.csv")
style = BarChartStyle(
    BarColor=RGB(50, 130, 190),
    BarHoverColor=RGB(255, 0, 0),
    Address=address,
    Margins=margins,
    Width=Slider(1400, range=0..10000),
    Height=Slider(600, range=0..1000),
    YAxisLabel="Total Insolation in kWh/m2",
    TickMarksX=Slider(7, range=0..10),
    XTextRotation=Toggle(True))
data = BarChartDataFromCSV(FilePath=path, Domain=domain)
chart = BarChart(Data=data, Style=style)
report = CreateReport(Chart0=chart)

# ---- group: Printing Method
fitmode = PdfFitMode({"NoAdjustment": 0, "ShrinkOnly": 1, "AutoFit": 2}, selected="AutoFit")
orientation = PdfOrientation({"Portrait": 0, "Landscape": 1}, selected="Portrait")
size = PdfSize({"Custom": 0, "Letter": 1, "Note": 2, "Legal": 3, "A0": 4, "A1": 5, "A2": 6, "A3": 7, "A4": 8, "A5": 9, "A6": 10, "A7": 11, "A8": 12, "A9": 13, "A10": 14, "B0": 15, "B1": 16, "B2": 17, "B3": 18, "B4": 19, "B5": 20, "ArchE": 21, "ArchD": 22, "ArchC": 23, "ArchB": 24, "ArchA": 25, "Flsa": 26, "HalfLetter": 27, "Letter11x17": 28, "Ledger": 29}, selected="Letter11x17")
style_2 = PdfStyle(
    PdfSize=size,
    PdfOrientation=orientation,
    PdfHorizontalFit=fitmode,
    PdfVerticalFit=fitmode,
    Compression=10,
    MarginTop=0,
    MarginRight=0,
    MarginBottom=0,
    MarginLeft=0)
pdf = PrintToPdf(FilePath="C:\Users\ksobon\Desktop\test.pdf", Report=report, Style=style_2, Print=Toggle(False))

# ----
window = LaunchWindow(Report=report, Show=Toggle(True))
