# Grasshopper definition horizontalbarchart.gh (Grasshopper 0.9.76)
# plug-ins: Mandrill

panel = Panel("""A
B
C""")
panel_2 = Panel("""12
5
20""")
panel_3 = Panel("""0
0
1""")
domain = Domain(Start=Slider(0, range=0..100), End=Slider(100, range=0..100))
merge = Merge(
    Data1=ColourSwatch(SwatchColor=RGB(255, 0, 255)),
    Data2=ColourSwatch(SwatchColor=RGB(0, 0, 255)),
    Data3=ColourSwatch(SwatchColor=RGB(0, 255, 255)),
    Data4=ColourSwatch(SwatchColor=RGB(255, 255, 0)),
    Data5=ColourSwatch(SwatchColor=RGB(114, 163, 0)),
    Data6=ColourSwatch(SwatchColor=RGB(80, 62, 0)))
margins = Margins(Top=20, Bottom=40, Right=20, Left=Slider(59, range=0..100))
address = Address(Column=Slider(3, range=0..100), Row=Slider(0, range=0..100))
path = FilePath("C:\Users\konrad.sobon\OneDrive - HOK\GoogleDrive\Work\Mandrill\_Samples\Dynamo\HorizontalBarChart\sampleData.csv")
data = HorizontalBarChartDataFromCSV(FilePath=path, Domain=domain)
data_2 = HorizontalBarChartData(Names=panel, Values=panel_2, Colors=panel_3)
style = HorizontalBarChartStyle(
    BarColor=merge,
    BarHoverColor=RGB(255, 0, 0),
    Address=address,
    Margins=margins,
    Width=Slider(917, range=0..10000),
    Height=500,
    XAxisLabel="Count")
chart = HorizontalBarChart(Data=data, Style=style)
report = CreateReport(Chart0=chart)
window = LaunchWindow(Report=report, Show=Toggle(True))
