# Grasshopper definition imageSample.gh (Grasshopper 0.9.76)
# plug-ins: Mandrill

address = Address(Column=Slider(1, range=0..10), Row=Slider(2, range=0..10))
number_slider = Slider(200, range=0..1000)
path = FilePath("E:\Google Drive\Work\Mandrill\_Logo\mandrillLogo-01.png")
style = ImageStyle(Address=address, Width=number_slider, Height=number_slider, Tooltip="SomeTooltip")
image = Image(FilePath=path, Style=style)
report = CreateReport(A=image)
window = LaunchWindow(Report=report, Show=Toggle(False))
