# Grasshopper definition parallelCoordinatesSample.gh (Grasshopper 0.9.76)
# plug-ins: Mandrill

path = FilePath("E:\Google Drive\Work\Mandrill\_DynamoSamples\ParallelCoordinatesChart\parallelCoordinatesData.csv")
style = ParallelCoordinatesStyle(LineColor=RGB(50, 130, 190), Width=1000, Height=500)
data = ParallelCoordinatesData()
data_2 = ParallelCoordinatesDataFromCSV(FilePath=path)
chart = ParallelCoordinates(Data=data_2, Style=style)
report = CreateReport(A=chart)
window = LaunchWindow(Report=report, Show=Toggle(True))
