# Grasshopper definition stackedBarChart.gh (Grasshopper 0.9.76)
# plug-ins: Mandrill

panel = Panel("""Name3
2
12
22""")
panel_2 = Panel("""Name1
2
12
22""")
panel_3 = Panel("""Name2
2
12
22""")
entwine = Entwine(Branch00=panel_2, Branch01=panel_3, Branch02=panel, FlattenInputs=True)  # -> simplify(Result)
panel_4 = Panel("""Names
Header1
Header2
Header3""")
data = StackedBarChartData(Headers=panel_4, Values=entwine)
panel_5 = Panel(data)
