# Grasshopper definition textSample.gh (Grasshopper 0.9.76)
# plug-ins: Mandrill

address = Address(Column=Slider(2, range=0..10), Row=Slider(4, range=0..10))
transform = FontTransform({"none", "capitalize", "lowercase", "uppercase"}, selected="none")
weight = FontWeight({"normal", "bold"}, selected="normal")
style = FontStyle({"normal", "oblique", "italic"}, selected="normal")
style_2 = TextStyle(
    FontColor=ColourSwatch(SwatchColor=RGB(255, 0, 255)),
    Address=address,
    Width="300",
    Height=100,
    FontSize=20,
    FontWeight=weight,
    FontStyle=style,
    FontTransform=transform)
text = Text(Text="someText", Style=style_2)
report = CreateReport(A=text)
window = LaunchWindow(Report=report, Show=Toggle(True))
